# Grasshopper definition Workshop_10_PythonNode_Visualization GH.ghx (Grasshopper 1.0.7)

path = FilePath("Z:\github\Introduction-to-computational-design-python\Workshop_04_PythonNode_Visualization.json")
pop3d = Populate3D(
    Region={Plane=PlaneXY(0, 0, 0), X=Domain(0, 10), Y=Domain(0, 10), Z=Domain(0, 2)},
    Count=Slider(100, range=0..100),
    Seed=Slider(4, range=0..10))

# ---- group: rhinoscriptsyntax
python = GhPythonScript(path=path, pts=pop3d)  # -> out, data, lines; inputs pts: list
# ---------- python: Python ----------
import json

json_file = open(path)
json_str = json_file.read()
data = json.loads(json_str)


for i in data:
    cons = i['connectivity']
    if len(cons) > 0:
        print i['id'], cons
        

import rhinoscriptsyntax as rs
lns = [];
for i in data:
    cons = i['connectivity']
    if len(cons) > 0:
        id = i['id']
        for i in cons:
            ln = rs.AddLine(pts[id], pts[i])
            lns.append(ln);

lines = lns;
# ---------- end python ----------

# ---- group: Rhino Common api
python_2 = GhPythonScript(path=path, pts=pop3d)  # -> out, data, lines; inputs pts: list of Point3d
# ---------- python_2: Python ----------
import json

json_file = open(path)
json_str = json_file.read()
data = json.loads(json_str)


for i in data:
    cons = i['connectivity']
    if len(cons) > 0:
        print i['id'], cons
        

import Rhino as r

lns = [];
for i in data:
    cons = i['connectivity']
    if len(cons) > 0:
        id = i['id']
        for i in cons:
            # Rhino Common api
            p0 = r.Geometry.Point3d(pts[id].X, pts[id].Y, pts[id].Z)
            p1 = r.Geometry.Point3d(pts[i].X, pts[i].Y, pts[i].Z)
            ln = r.Geometry.Line(p0, p1)
            
            lns.append(ln);

lines = lns;
# ---------- end python_2 ----------

# ----
panel = Panel(python.out)
panel_2 = Panel(python_2.out)
